# Grasshopper definition 2022.04.29.gh (Grasshopper 1.0.7)

number_slider = Slider(41, range=0..100)
number_slider_2 = Slider(55, range=0..100)
box = Box({Plane=PlaneXY(2504.258314, -1055.407416, 0), X=Domain(0, 413.4284011), Y=Domain(0, 348.62979), Z=Domain(0, 376.4024849)})
box_2 = Box({Plane=PlaneXY(2097.896518, -1112.970225, 0), X=Domain(0, 367.0396011), Y=Domain(0, 448.0576431), Z=Domain(0, 382.7500868)})
populate_geometry = PopulateGeometry(Geometry=box, Count=number_slider, Seed=1)
populate_geometry_2 = PopulateGeometry(Geometry=box_2, Count=number_slider, Seed=number_slider_2)
populate_2d = Populate2D(
    Region={Plane=PlaneXY(1028.568387, -2089.267433, 0), Size=Domain2(u=-439.4581624..439.4581624, v=-532.5420833..532.5420833)},
    Count=number_slider,
    Seed=number_slider_2)
populate_2d_2 = Populate2D(
    Region={Plane=PlaneXY(1028.568387, -2089.267433, 295.2620124), Size=Domain2(u=-439.4581624..439.4581624, v=-532.5420833..532.5420833)},
    Count=number_slider,
    Seed=1)
list_item_plus = ListItemPlusGeometry()  # -> Item, ItemB; inputs Trees: tree of GeometryBase, Index: Int32
# ---------- list_item_plus: C# usings ----------
using System.IO;
using System.Linq;
using System.Data;
using System.Drawing;
using System.Reflection;
using System.Windows.Forms;
using System.Xml;
using System.Xml.Linq;
using System.Runtime.InteropServices;

using Rhino.DocObjects;
using Rhino.Collections;
using GH_IO;
using GH_IO.Serialization;
# ---------- list_item_plus: C# ----------
    Component.Name = "List Item Plus(Geometry)";
    Component.NickName = "List Item Plus";
    DataTree < GeometryBase > Tree1 = new DataTree<GeometryBase>();
    DataTree < GeometryBase > Tree2 = new DataTree<GeometryBase>();
    foreach(GH_Path path in Trees.Paths)
    {
      Tree1.Add(Trees.Branch(path)[Index], path);
    }
    foreach(GH_Path path in Trees.Paths)
    {
      Tree2.Add(Trees.Branch(path)[Index + 1], path);
    }
    Item = Tree1;
    ItemB = Tree2;
# ---------- end list_item_plus ----------
c_script = CSharpScript(OPC=populate_geometry, PC=populate_geometry_2)  # -> out, A, B, C; inputs OPC: list of Point3d, PC: list
# ---------- c_script: C# usings ----------
using Rhino.Collections;
# ---------- c_script: C# ----------
    Point3dList PCL = new Point3dList();
    List<Point3d> PCPP = new List<Point3d>();
    List<Polyline> PCC = new List<Polyline>();
    foreach(Point3d P1 in PC)
    {
      PCL.Add(P1);
    }
    for(int i = 0; i < OPC.Count; i++)
    {
      Point3d PCP = Point3dList.ClosestPointInList(PCL, OPC[i]);
      int PCPI = Point3dList.ClosestIndexInList(PCL, OPC[i]);
      PCPP.Add(PCP);
      List < Point3d > FP = new List<Point3d>();
      FP.Add(OPC[i]);
      FP.Add(PCPP[i]);
      Polyline FC = new Polyline(FP);
      PCC.Add(FC);
    }

    A = PCL;
    B = PCPP;
    C = PCC;
# ---------- end c_script ----------
c_script_2 = CSharpScript(OPC=populate_2d_2, PC=populate_2d)  # -> out, A, B, C; inputs OPC: list of Point3d, PC: list
# ---------- c_script_2: C# ----------
    Point3dList PCL = new Point3dList();
    List<Point3d> PCPP = new List<Point3d>();
    List<Polyline> PCC = new List<Polyline>();
    foreach(Point3d P1 in PC)
    {
      PCL.Add(P1);
    }
    for(int i = 0; i < OPC.Count; i++)
    {
      Point3d PCP = Point3dList.ClosestPointInList(PCL, OPC[i]);
      int PCPI = Point3dList.ClosestIndexInList(PCL, OPC[i]);
      PCPP.Add(PCP);   
    }
    for(int i = 0; i < OPC.Count; i++)
    {
        List < Point3d > FP = new List<Point3d>();
      FP.Add(OPC[i]);
      FP.Add(PCPP[i]);
        Polyline FC = new Polyline(FP);
        PCC.Add(FC);
    }
    
    A = PCL;
    B = PCPP;
    C = PCC;
# ---------- end c_script_2 ----------
division = Division(A=Slider(676, range=0..1000), B=number_slider)
data = Data(c_script.C)
data_2 = Data(c_script.B)
data_3 = Data(c_script_2.A)
data_4 = Data(c_script_2.B)
param_viewer = ParamViewer(data_4)
panel = Panel(division)
list_item_plus_2 = ListItemPlusGeometry()  # -> Item, ItemB; inputs Trees: tree of GeometryBase, Index: Int32; same code as list_item_plus
